# Grasshopper definition verlaufsschraffur_kurve_kurve.gh (Grasshopper 1.0.8)
# Copyright: 2022

# ---- group: Boundary Kurve
crv = Curve(<curve referenced from the Rhino model>)

# ----
py3 = Python3Script(reset=Button())  # -> a
# ---------- py3: Python ----------
from compas_ghpython import unload_modules

unload_modules("jh_ghp_tools")

if reset:
    unload_modules("jh_ghp_tools")
# ---------- end py3 ----------

# ---- group: Attractor 100%
crv_2 = Curve(<curve referenced from the Rhino model>)

# ---- group: Attractor0%
crv_3 = Curve(<curve referenced from the Rhino model>)

# ----
dichte = ValueList({"1:200": 10, "1:100": 10, "1:50": 10, "1:20": 10}, selected="1:200")
grösse_quadrant = ValueList({"1:200": 0.2, "1:100": 0.1, "1:50": 0.05, "1:20": 0.02, "Test": 1.0}, selected="1:200")
disc = Discontinuity(Curve=crv, Level=2)  # -> Points, Parameters
bbox = BoundingBox(Content=crv, Plane=PlaneXY(0, 0, 0))  # -> Box, Box_2
pline = PolyLine(Vertices=disc.Points, Closed=False)
isonometrie = Panel("0.8")
disc_2 = Discontinuity(Curve=crv_2, Level=2)  # -> Points, Parameters
disc_3 = Discontinuity(Curve=crv_3, Level=2)  # -> Points, Parameters
area = Area(Geometry=bbox.Box)  # -> Area, Centroid
debox = DeconstructBox(Box=bbox.Box)  # -> Plane, X, Y, Z
pline_2 = PolyLine(Vertices=disc_2.Points, Closed=False)
pline_3 = PolyLine(Vertices=disc_3.Points, Closed=False)
expression = Expression(A=area.Area, q=grösse_quadrant, d=dichte, Expression="A/(q^2)*d")
nicht_lineare_abnahme = ValueList({"nicht": 1, "1.2", "1.4", "1.6", "1.8", "stark": 2}, selected="1.4")
dam = DataDam(
    DataA=debox.X,
    DataB=debox.Y,
    DataC=expression,
    DataD=pline,
    DataE=pline_2,
    DataF=pline_3,
    BufferDelay=10000000,
    BufferMode=0)  # -> DataA, DataB, DataC, DataD, DataE, DataF
list = ValueList({"1:200": 0.04, "1:100": 0.02, "1:50": 0.01, "1:20": 0.004}, selected="1:200")
py3_2 = Python3Script(
    x_domain=dam.DataA,
    y_domain=dam.DataB,
    N=dam.DataC,
    CB=dam.DataD,
    C1=dam.DataE,
    C0=dam.DataF,
    cell_size=".2",
    gamma=nicht_lineare_abnahme,
    min_dist=list)  # -> points; inputs x_domain: Interval, y_domain: Interval, N: Int32, CB: Curve, C1: Curve, C0: Curve, cell_size: Double, gamma: Double, min_dist: Double
# ---------- py3_2: Python ----------
from jh_ghp_tools import verlaufsschraffur_kurve_kurve

points = verlaufsschraffur_kurve_kurve(x_domain, y_domain, N, CB, C1, C0, cell_size, gamma, min_dist)
# ---------- end py3_2 ----------
list_2 = ValueList({"1:200": 0.01, "1:100": 0.005, "1:50": 0.0025, "1:20": 0.001}, selected="1:200")
isonometrie_2 = Panel(".1")
py3_3 = Python3Script(P=py3_2, L=list_2)  # -> C; inputs P: list of Point3d, L: Double
# ---------- py3_3: Python ----------
import ghpythonlib.components as gh
import Grasshopper.Kernel as gk
from ghpythonlib.componentbase import executingcomponent as component
import random
import Rhino


class ExampleComponent(component):
    def RunScript(self, P: list[Rhino.Geometry.Point3d], L: float):
        # do the work here
        C = None

        if not P:
            w = gk.GH_RuntimeMessageLevel.Warning
            ghenv.Component.AddRuntimeMessage(w, "Add Point Input")
            return

        L = L or 0.01

        domain_min, domain_max = 0, gh.Pi(2) # Manuell den Bereich fÃ¼r den Zufall definieren
        plane = gh.XYPlane(gh.ConstructPoint(0.0, 0.0, 0.0))

        curves = []
        for p in P:
            random_value = random.uniform(domain_min, domain_max)
            vector = gh.UnitX(L)
            rotated_vector = gh.Rotate(vector, random_value, plane)[0]
            curve = gh.LineSDL(p, rotated_vector, L)
            curves.append(curve)

        return curves
# ---------- end py3_3 ----------
group = Group(Objects=py3_3)
