# Grasshopper definition wohnungsteilung.gh (Grasshopper 1.0.8)

panel = Panel("""50
66
92
114""")

py3 = Python3Script(reset=Button())  # -> a
# ---------- py3: Python ----------
from compas_ghpython import unload_modules

unload_modules("jh_ghp_tools")

if reset:
    unload_modules("jh_ghp_tools")
# ---------- end py3 ----------

py3_2 = Python3Script(Module=panel, Gesamtflaeche="230", MaxRest="25")  # -> out; inputs Module: list of Double, Gesamtflaeche: Double, MaxRest: Double
# ---------- py3_2: Python ----------
from jh_ghp_tools import wohnungsteilung


wohnungsteilung(Module, Gesamtflaeche, MaxRest)
# ---------- end py3_2 ----------
panel_2 = Panel(py3_2)
